# Grasshopper definition parade_parametrizada.gh (Grasshopper 1.0.7)

panel = Panel("TIJOLO A VISTA 10x6x20 cm")

comprimento = Slider(20, range=0..100)
largura = Slider(10, range=0..10)
altura = Slider(6, range=0..10)
domain_box = DomainBox(Base=PlaneXY(0, 0, 0), X=comprimento, Y=largura, Z=altura)

# ----
# Parede de teste
# 5 x 3 metros
panel_2 = Panel("300")
# https://www.archdaily.com.br/br/797614/16-detalhes-construtivos-de-aparelhamento-de-tijolos
# Unidade usada no Rhino -> cm (units)
# https://www.youtube.com/watch?v=stYu0Kfe3Ps
construct_point = ConstructPoint(XCoordinate=0, YCoordinate=0, ZCoordinate=0)
construct_point_2 = ConstructPoint(XCoordinate=0, YCoordinate="500", ZCoordinate=0)
unit_z = UnitZ(Factor=panel_2)
line = Line(StartPoint=construct_point, EndPoint=construct_point_2)
extrude = Extrude(Base=line, Direction=unit_z)

comprimento_2 = Slider(20, range=0..100)
largura_2 = Slider(10, range=0..10)
altura_2 = Slider(6, range=0..10)
domain_box_2 = DomainBox(Base=PlaneXY(0, 0, 0), X=comprimento_2, Y=largura_2, Z=altura_2)

# ----
# Parede de teste
# 5 x 3 metros
panel_4 = Panel("300")
construct_point_3 = ConstructPoint(XCoordinate=0, YCoordinate=0, ZCoordinate=0)
construct_point_4 = ConstructPoint(XCoordinate=0, YCoordinate="500", ZCoordinate=0)
unit_z_2 = UnitZ(Factor=panel_4)
line_2 = Line(StartPoint=construct_point_3, EndPoint=construct_point_4)
extrude_2 = Extrude(Base=line_2, Direction=unit_z_2)

comprimento_3 = Slider(20, range=0..100)
largura_3 = Slider(10, range=0..10)
altura_3 = Slider(6, range=0..10)
domain_box_3 = DomainBox(Base=PlaneXY(0, 0, 0), X=comprimento_3, Y=largura_3, Z=altura_3)

# ----
# Parede de teste
# 5 x 3 metros
panel_6 = Panel("300")
construct_point_5 = ConstructPoint(XCoordinate=0, YCoordinate=0, ZCoordinate=0)
construct_point_6 = ConstructPoint(XCoordinate=0, YCoordinate="500", ZCoordinate=0)
unit_z_3 = UnitZ(Factor=panel_6)
line_3 = Line(StartPoint=construct_point_5, EndPoint=construct_point_6)
extrude_3 = Extrude(Base=line_3, Direction=unit_z_3)

box = Box(domain_box)

# ---- group: altura
integer = Integer(altura)

# ----
# parede cobogó
unit_z_4 = UnitZ(Factor=1)
# parede amarrada
unit_z_5 = UnitZ(Factor=1)
box_2 = Box(domain_box_2)

# ---- group: altura
integer_2 = Integer(altura_2)

# ----
surface = Surface(extrude)
# parede cobogó
unit_z_6 = UnitZ(Factor=1)
box_3 = Box(domain_box_3)

# ---- group: altura
integer_3 = Integer(altura_3)

# ----
surface_2 = Surface(extrude_2)
surface_3 = Surface(extrude_3)
# A distância desconsidera argamassa, então recebe a mesma altura do tijolo
contour = Contour(Shape=surface_2, Point=Point(0, 0, 0), Direction=unit_z_4, Distance=integer_2)  # -> flatten(Contours)
comprimento_parede = Panel("500")
comprimento_tijolo = Panel(comprimento_2)
# A distância desconsidera argamassa, então recebe a mesma altura do tijolo
contour_2 = Contour(Shape=surface, Point=Point(0, 0, 0), Direction=unit_z_5, Distance=integer)  # -> flatten(Contours)
comprimento_parede_2 = Panel("500")
comprimento_tijolo_2 = Panel(comprimento)
# A distância desconsidera argamassa, então recebe a mesma altura do tijolo
contour_3 = Contour(Shape=surface_3, Point=Point(0, 0, 0), Direction=unit_z_6, Distance=integer_3)  # -> flatten(Contours)
deconstruct_brep = DeconstructBrep(Brep=box)  # -> Faces, Edges, Vertices
deconstruct_brep_2 = DeconstructBrep(Brep=box_2)  # -> Faces, Edges, Vertices
division = Division(A=comprimento_parede, B=comprimento_tijolo)
# Separa as linhas impares das pares.
# 
# Fiadas impares e fiadas pares
dispatch = Dispatch(List=contour, DispatchPattern=[True, False])  # -> ListA, ListB
division_2 = Division(A=comprimento_parede_2, B=comprimento_tijolo_2)
# Separa as linhas impares das pares.
# 
# Fiadas impares e fiadas pares
dispatch_2 = Dispatch(List=contour_2, DispatchPattern=[True, False])  # -> ListA, ListB
number_slider = Slider(33, range=0..100)
deconstruct_brep_3 = DeconstructBrep(Brep=box_3)  # -> Faces, Edges, Vertices
# Separa as linhas impares das pares.
# 
# Fiadas impares e fiadas pares
dispatch_3 = Dispatch(List=contour_3, DispatchPattern=[True, False])  # -> ListA, ListB
number_slider_2 = Slider(33, range=0..100)
multiplication = Multiplication(A=division_2, B="2")
list_item = ListItem(List=deconstruct_brep.Faces, Index=Slider(4, range=0..10), Wrap=True)
panel_7 = Panel(division)
curve = Curve(dispatch.ListA)
curve_2 = Curve(dispatch.ListB)
panel_8 = Panel(multiplication)
panel_9 = Panel(division_2)
list_item_2 = ListItem(List=deconstruct_brep_2.Faces, Index=Slider(4, range=0..10), Wrap=True)
curve_3 = Curve(dispatch_2.ListA)
curve_4 = Curve(dispatch_2.ListB)
curve_5 = Curve(dispatch_3.ListA)
curve_6 = Curve(dispatch_3.ListB)
list_item_3 = ListItem(List=deconstruct_brep_3.Faces, Index=Slider(4, range=0..10), Wrap=True)
area = Area(Geometry=list_item)  # -> Area, Centroid
# Aqui os tijolos estariam alinhados (junta prumo)
horizontal_frames = HorizontalFrames(Curve=curve, Count=division)  # -> Frames, Parameters
horizontal_frames_2 = HorizontalFrames(Curve=curve_2, Count=division)  # -> Frames, Parameters
# Aqui os tijolos estariam alinhados (junta prumo)
horizontal_frames_3 = HorizontalFrames(Curve=curve_3, Count=multiplication)  # -> Frames, Parameters
area_2 = Area(Geometry=list_item_2)  # -> Area, Centroid
horizontal_frames_4 = HorizontalFrames(Curve=curve_4, Count=multiplication)  # -> Frames, Parameters
# Aqui os tijolos estariam alinhados (junta prumo)
horizontal_frames_5 = HorizontalFrames(Curve=curve_5, Count=number_slider_2)  # -> Frames, Parameters
horizontal_frames_6 = HorizontalFrames(Curve=curve_6, Count=number_slider_2)  # -> Frames, Parameters
area_3 = Area(Geometry=list_item_3)  # -> Area, Centroid
point = Point(area.Centroid)
point_2 = Point(area_2.Centroid)
dispatch_4 = Dispatch(List=horizontal_frames.Frames, DispatchPattern=[True, False])  # -> ListA, ListB
dispatch_5 = Dispatch(List=horizontal_frames_2.Frames, DispatchPattern=[True, False])  # -> ListA, ListB
dispatch_6 = Dispatch(List=horizontal_frames_3.Frames, DispatchPattern=[True, False])  # -> ListA, ListB
dispatch_7 = Dispatch(List=horizontal_frames_4.Frames, DispatchPattern=[True, False])  # -> ListA, ListB
point_3 = Point(area_3.Centroid)
dispatch_8 = Dispatch(List=horizontal_frames_5.Frames, DispatchPattern=[True, False])  # -> ListA, ListB
dispatch_9 = Dispatch(List=horizontal_frames_6.Frames, DispatchPattern=[True, False])  # -> ListA, ListB
plane = Plane(horizontal_frames_2.Frames)
# Aqui os tijolos ficam alternados (amarrados)
plane_2 = Plane(horizontal_frames.Frames)
plane_3 = Plane(dispatch_7.ListB)
# Aqui os tijolos ficam alternados (amarrados)
plane_4 = Plane(dispatch_6.ListA)
plane_5 = Plane(dispatch_9.ListB)
# Aqui os tijolos ficam alternados (amarrados)
plane_6 = Plane(dispatch_8.ListA)
orient = Orient(Geometry=box_2, Source=point_2, Target=plane_2)  # -> Geometry, Transform
orient_2 = Orient(Geometry=box_2, Source=point_2, Target=plane)  # -> Geometry, Transform
orient_3 = Orient(Geometry=box, Source=point, Target=plane_4)  # -> Geometry, Transform
orient_4 = Orient(Geometry=box, Source=point, Target=plane_3)  # -> Geometry, Transform
orient_5 = Orient(Geometry=box_3, Source=point_3, Target=plane_6)  # -> Geometry, Transform
orient_6 = Orient(Geometry=box_3, Source=point_3, Target=plane_5)  # -> Geometry, Transform
